# Grasshopper definition carbon.ghx (Grasshopper 1.0.7)
# plug-ins: Wombat

wall_carbon = GetNumber(AtLeast=1, AtMost=1, Maximum=1.797693135e+308, Minimum=-1.797693135e+308, TreeAccess=False)
column_carbon = GetNumber(AtLeast=1, AtMost=1, Maximum=1.797693135e+308, Minimum=-1.797693135e+308, TreeAccess=False)
beam_carbon = GetNumber(AtLeast=1, AtMost=1, Maximum=1.797693135e+308, Minimum=-1.797693135e+308, TreeAccess=False)
grid_u = GetInteger(AtLeast=1, AtMost=1, Maximum=2147483647, Minimum=-2147483648, TreeAccess=False)
grid_v = GetInteger(AtLeast=1, AtMost=1, Maximum=2147483647, Minimum=-2147483648, TreeAccess=False)
roof_carbon = GetNumber(AtLeast=1, AtMost=1, Maximum=1.797693135e+308, Minimum=-1.797693135e+308, TreeAccess=False)
slab_carbon = GetNumber(AtLeast=1, AtMost=1, Maximum=1.797693135e+308, Minimum=-1.797693135e+308, TreeAccess=False)
office_floors = GetInteger(AtLeast=1, AtMost=1, Maximum=2147483647, Minimum=-2147483648, TreeAccess=False)
shed = GetGeometry(AtLeast=1, AtMost=1, DeleteInput=False, Filter=1074004029, TreeAccess=False)
office = GetGeometry(AtLeast=1, AtMost=1, DeleteInput=False, Filter=1074004029, TreeAccess=False)
fbd = BrepFacesByDirection(Brep=shed, Tolerance=0.9)  # -> Top, Bottom, Sides
fbd_2 = BrepFacesByDirection(Brep=office, Tolerance=0.9)  # -> Top, Bottom, Sides
srf = Surface(fbd_2.Bottom)
area = Area(Geometry=fbd.Top)  # -> Area, Centroid
area_2 = Area(Geometry=fbd.Bottom)  # -> Area, Centroid
area_3 = Area(Geometry=fbd_2.Top)  # -> Area, Centroid
area_4 = Area(Geometry=fbd_2.Bottom)  # -> Area, Centroid
dist = Distance(PointA=area_3.Centroid, PointB=area_4.Centroid)
dist_2 = Distance(PointA=area.Centroid, PointB=area_2.Centroid)
division = Division(A=dist, B=office_floors)
series = Series(Start=0, Step=division, Count=office_floors)
Z = UnitZ(Factor=series)
move = Move(Geometry=srf, Motion=Z)  # -> Geometry, Transform
area_5 = Area(Geometry=move.Geometry)  # -> Area, Centroid
Z_2 = UnitZ(Factor=dist_2)
sdivide = DivideSurface(Surface=fbd.Bottom, UCount=grid_u, VCount=grid_v)  # -> Points, Normals, Parameters
line = LineSDL(Start=sdivide.Points, Direction=Z_2, Length=Z_2)
flip = FlipMatrix(Data=sdivide.Points)
pline = PolyLine(Vertices=sdivide.Points, Closed=False)
pline_2 = PolyLine(Vertices=flip, Closed=False)
join = JoinCurves(Curves=[pline, pline_2], Preserve=False)
move_2 = Move(Geometry=join, Motion=Z_2)  # -> Geometry, Transform
number_slider = Slider(0.2, range=0..1)

# ---- group: Roof
geo = Geometry(flatten([fbd.Top, fbd_2.Top]))

# ---- group: Beams
geo_2 = Geometry(flatten(move_2.Geometry))

# ---- group: Slabs
geo_3 = Geometry(flatten([move.Geometry, fbd.Bottom]))

# ---- group: Walls
geo_4 = Geometry(flatten([fbd.Sides, fbd_2.Sides]))

# ---- group: Columns
geo_5 = Geometry(flatten(line))

# ----
roof_thickness = Slider(0.03, range=0..0.1)
slab_thickness = Slider(0.3, range=0..1)
wall_thickness = Slider(0.6, range=0..1)
column_beam_thickness = Slider(0.5, range=0..1)
pipe = Pipe(Curve=geo_5, Radius=number_slider, Caps=0)  # -> flatten(Pipe)
pipe_2 = Pipe(Curve=geo_2, Radius=number_slider, Caps=0)  # -> flatten(Pipe)
area_6 = Area(Geometry=geo)  # -> Area, Centroid
area_7 = Area(Geometry=geo_3)  # -> Area, Centroid
area_8 = Area(Geometry=geo_4)  # -> Area, Centroid
len = Length(Curve=geo_5)
len_2 = Length(Curve=geo_2)
ma = MassAddition(Input=flatten([area_5.Area, area_2.Area]))  # -> Result, PartialResults
ma_2 = MassAddition(Input=area_6.Area)  # -> Result, PartialResults
ma_3 = MassAddition(Input=area_7.Area)  # -> Result, PartialResults
ma_4 = MassAddition(Input=area_8.Area)  # -> Result, PartialResults
ma_5 = MassAddition(Input=len)  # -> Result, PartialResults
ma_6 = MassAddition(Input=len_2)  # -> Result, PartialResults
multiplication = Multiplication(A=ma_4.Result, B=wall_carbon, C=wall_thickness)
multiplication_2 = Multiplication(A=ma_5.Result, B=column_carbon, C=column_beam_thickness)
multiplication_3 = Multiplication(A=ma_6.Result, B=beam_carbon, C=column_beam_thickness)
multiplication_4 = Multiplication(A=ma_2.Result, B=roof_carbon, C=roof_thickness)
multiplication_5 = Multiplication(A=ma_3.Result, B=slab_carbon, C=slab_thickness)
entwine = Entwine(Branch00=geo, Branch01=geo_3, Branch02=geo_4, Branch03=pipe, Branch04=pipe_2, FlattenInputs=True)
merge = Merge(Data1=multiplication_4, Data2=multiplication_5, Data3=multiplication, Data4=multiplication_2, Data5=multiplication_3)
ma_7 = MassAddition(Input=flatten([multiplication_4, multiplication_5, multiplication, multiplication_2, multiplication_3]))  # -> Result, PartialResults
sort = SortList(Keys=merge)  # -> Keys, ValuesA
item = ListItem(List=sort.Keys, Index=0, Wrap=True)  # -> Item1, Item
gradient = Gradient(
    LowerLimit=item.Item,
    UpperLimit=item.Item1,
    Parameter=merge,
    stops=[0: RGB(0, 128, 0), 0.5: RGB(255, 255, 0), 1: RGB(255, 0, 0)])
mcol = MeshColours(Mesh=entwine, Colours=graft(gradient))

# ---- group: RH_OUT:Roof
num = Number(multiplication_4)

# ---- group: RH_OUT:Slabs
num_2 = Number(multiplication_5)

# ---- group: RH_OUT:GFA
num_3 = Number(ma.Result)

# ---- group: RH_OUT:Walls
num_4 = Number(multiplication)

# ---- group: RH_OUT:Columns
num_5 = Number(multiplication_2)

# ---- group: RH_OUT:Beams
num_6 = Number(multiplication_3)

# ---- group: RH_OUT:TotalCarbon
num_7 = Number(ma_7.Result)

# ----
bang = ExplodeTree(Data=mcol)  # -> Branch0, Branch1, Branch2, Branch3, Branch4

# ---- group: RH_OUT:MeshRoof
mesh = Mesh(bang.Branch0)

# ---- group: RH_OUT:MeshSlab
mesh_2 = Mesh(bang.Branch1)

# ---- group: RH_OUT:MeshWall
mesh_3 = Mesh(bang.Branch2)

# ---- group: RH_OUT:MeshColumn
mesh_4 = Mesh(bang.Branch3)

# ---- group: RH_OUT:MeshBeam
mesh_5 = Mesh(bang.Branch4)
