# Grasshopper definition 30km_iso.ghx (Grasshopper 1.0.7)
# plug-ins: GraphicPlus, Human

number_slider = Slider(15000, range=0..100000)
geometry = GetGeometry(AtLeast=1, AtMost=2147483647, DeleteInput=False, Filter=1074004029, TreeAccess=True)
filename = GetString(AtLeast=1, AtMost=2147483647, TreeAccess=True)
foldername = GetString(AtLeast=1, AtMost=2147483647, TreeAccess=True)
flatten = FlattenTree(Tree=filename, Path="{0}")
flatten_2 = FlattenTree(Tree=geometry, Path="{0}")
flatten_3 = FlattenTree(Tree=foldername, Path="{0}")
dom = ConstructDomain(DomainStart=expr("-x", number_slider), DomainEnd=number_slider)
rectangle = Rectangle(Plane=PlaneXY(0, 0, 0), XSize=dom, YSize=dom, Radius=0)  # -> Rectangle, Length
divlength = DivideLength(Curve=flatten_2, Length=Slider(1, range=0..1))  # -> Points, Tangents, Parameters
concat = Concatenate(FragmentA="C:\Users\Administrator\OneDrive - nettletontribe\Compute\", FragmentB=flatten_3)
pline = PolyLine(Vertices=divlength.Points, Closed=False)
mesh = Mesh(pline)
stroke = Stroke(ShapeGeometry=mesh, Color=ColourSwatch(SwatchColor=RGB(99, 98, 98)), Weight=Slider(2.5, range=0..10), EndCap=0)
drawing = ConstructDrawing(ShapesGeometry=stroke, Boundary=rectangle.Rectangle, Color=RGBA(255, 255, 255, 0))  # -> Drawing, Boundary
savebmp = SaveBitmap(
    DrawingsShapesGeometry=drawing.Drawing,
    FolderPath=concat,
    FileName=flatten,
    Extension=0,
    Resolution=96,
    Save=Toggle(True))
img2str = SerializeImageToString(ImagePath=savebmp)

# ---- group: RH_OUT:StringImage
txt = Text(img2str)
