# Grasshopper definition PropertyOffsets.ghx (Grasshopper 1.0.7)
# plug-ins: Pufferfish

roads = GetGeometry(AtLeast=1, AtMost=2147483647, DeleteInput=False, Filter=1074004029, TreeAccess=True)
boundary = GetGeometry(AtLeast=1, AtMost=2147483647, DeleteInput=False, Filter=1074004029, TreeAccess=True)
hob = GetNumber(AtLeast=1, AtMost=2147483647, Maximum=1.797693135e+308, Minimum=-1.797693135e+308, TreeAccess=True)
buildings = GetGeometry(AtLeast=1, AtMost=2147483647, DeleteInput=False, Filter=1074004029, TreeAccess=True)
boundary_2 = BoundarySurfaces(Edges=boundary)
shapein = ShapeInBrep(Brep=buildings, Shape=boundary_2)
debrep = DeconstructBrep(Brep=boundary)  # -> Faces, Edges, Vertices
# No. of Frontages
curvepoint = PointOnCurve(debrep.Edges, parameter=0.5)
join = JoinCurves(Curves=roads, Preserve=False)
area = Area(Geometry=debrep.Faces)  # -> Area, Centroid
# Primary Setback
panel = Panel("1")
equals = Equality(FirstNumber=shapein, SecondNumber=panel)  # -> Equality, Inequality
# Primary Setback
list = ValueList({"One Frontage": 1, "Two Frontages": 2}, selected="One Frontage")
circle = CircleCNR(Center=area.Centroid, Normal=Vector(0, 0, 1), Radius="50")
list_2 = ValueList({"1", "2", "3", "4", "5", "6", "7", "8", "9", "10"}, selected="6")
list_3 = ValueList({"1", "2", "3", "4", "5", "6", "7", "8", "9", "10"}, selected="4")
# Secondary Setback
list_4 = ValueList({"1", "2", "3", "4", "5", "6", "7", "8", "9", "10"}, selected="1")
cull = CullPattern(List=buildings, CullPattern=equals.Inequality)
boundary_3 = BoundarySurfaces(Edges=circle)
scx = SurfaceCurve(Surface=boundary_3, Curve=join)  # -> Curves, Points, UVPoints, Normals, Parameters, Tangents
divdist = DivideDistance(Curve=scx.Curves, Distance="5")  # -> Points, Tangents, Parameters
ln = Line(StartPoint=flatten(divdist.Points), EndPoint=graft(curvepoint))
len = Length(Curve=ln)
hilonums = HighestLowestNumbers(Numbers=len)  # -> Highest, Lowest
pshift = ShiftPaths(Data=hilonums.Lowest, Offset="-1")
sort = SortList(Keys=pshift, ValuesA=debrep.Edges)  # -> Keys, ValuesA
split = SplitList(List=sort.ValuesA, Index=list)  # -> ListA, ListB
offset = OffsetCurve(Curve=split.ListA, Distance=list_2, Corners=1)
offset_2 = OffsetCurve(Curve=split.ListB, Distance=list_4, Corners=1)
offset_3 = OffsetCurve(Curve=split.ListA, Distance=list_3, Corners=1)
offset_4 = OffsetCurve(Curve=split.ListB, Distance=list_4, Corners=1)
ext = ExtendCurve(Curve=offset_2, Type=0, Start="10", End="10")
ext_2 = ExtendCurve(Curve=offset, Type=0, Start="10", End="10")
ext_3 = ExtendCurve(Curve=offset_4, Type=0, Start="5", End="5")
ext_4 = ExtendCurve(Curve=offset_3, Type=0, Start="5", End="5")
merge = Merge(Data1=ext_2, Data2=ext)  # -> flatten(Result)
merge_2 = Merge(Data1=ext_4, Data2=ext_3)  # -> flatten(Result)
join_2 = JoinCurves(Curves=merge_2, Preserve=False)
join_3 = JoinCurves(Curves=merge, Preserve=False)
srfsplit = SurfaceSplit(Surface=debrep.Faces, Curves=join_2)
srfsplit_2 = SurfaceSplit(Surface=debrep.Faces, Curves=join_3)
area_2 = Area(Geometry=srfsplit)  # -> Area, Centroid
area_3 = Area(Geometry=srfsplit_2)  # -> Area, Centroid
sort_2 = SortList(Keys=area_2.Area, ValuesA=srfsplit)  # -> reverse(Keys), reverse(ValuesA)
sort_3 = SortList(Keys=area_3.Area, ValuesA=srfsplit_2)  # -> reverse(Keys), reverse(ValuesA)
item = ListItem(List=sort_2.ValuesA, Index=0, Wrap=True)
item_2 = ListItem(List=sort_3.ValuesA, Index=0, Wrap=True)
Z = UnitZ(Factor="10")
Z_2 = UnitZ(Factor="10")
extr = Extrude(Base=item, Direction=Z)
move = Move(Geometry=item_2, Motion=Z_2)  # -> Geometry, Transform
Z_3 = UnitZ(Factor=hob)
extr_2 = Extrude(Base=move.Geometry, Direction=Z_3)
sunion = SolidUnion(Breps=[extr, extr_2])

# ---- group: RH_OUT:Geometry
geo = Geometry(sunion)

# ---- group: RH_OUT:Existing
geo_2 = Geometry(cull)
