# Grasshopper definition admin.ghx (Grasshopper 1.0.7)

curves = GetGeometry(AtLeast=1, AtMost=2147483647, DeleteInput=False, Filter=1074004029, TreeAccess=True)
admin = GetString(AtLeast=1, AtMost=2147483647, TreeAccess=True)
flatten = FlattenTree(Tree=admin, Path="{0}")
cset = CreateSet(List=flatten)  # -> Set, Map
flatten_2 = FlattenTree(Tree=curves, Path="{0}")
lng = ListLength(List=cset.Set)  # -> expr("x-1", Length)
gradient = Gradient(
    LowerLimit=0,
    UpperLimit=lng,
    Parameter=cset.Map,
    stops=[0: RGB(220, 220, 220), 0.5: RGB(0, 128, 128), 1: RGB(47, 66, 244)])
area = Area(Geometry=flatten_2)  # -> Area, Centroid
sort = SortList(Keys=area.Area, ValuesA=flatten_2, ValuesB=gradient, ValuesC=flatten)  # -> Keys, ValuesA, ValuesB, ValuesC
boundary = BoundarySurfaces(Edges=graft(sort.ValuesA))  # -> flatten(Surfaces)

# ---- group: RH_OUT:Values
txt = Text(flatten(sort.ValuesC))

# ---- group: RH_OUT:Colors
txt_2 = Text(sort.ValuesB)

# ---- group: RH_OUT:Surface
geo = Geometry(boundary)
