# Grasshopper definition adminColors.ghx (Grasshopper 1.0.7)
# plug-ins: GraphicPlus, Human

panel = Panel("C:\Users\RhinoComputeUser\OneDrive - nettletontribe\Compute\")
filename = GetString(AtLeast=1, AtMost=2147483647, TreeAccess=True)
geometry = GetGeometry(AtLeast=1, AtMost=2147483647, DeleteInput=False, Filter=1074004029, TreeAccess=True)
vals = GetString(AtLeast=1, AtMost=2147483647, TreeAccess=True)
foldername = GetString(AtLeast=1, AtMost=1, TreeAccess=False)
flatten = FlattenTree(Tree=filename, Path="{0}")
flatten_2 = FlattenTree(Tree=geometry, Path="{0}")
flatten_3 = FlattenTree(Tree=vals, Path="{0}")
flatten_4 = FlattenTree(Tree=foldername, Path="{0}")
mesh = Mesh(flatten_2)
number_slider = Slider(5000, range=0..10000)
concat = Concatenate(FragmentA=panel, FragmentB=flatten_4)
sort = SortList(Keys=mesh, ValuesA=mesh, ValuesB=flatten_3)  # -> Keys, reverse(ValuesA), reverse(ValuesB)
cset = CreateSet(List=sort.ValuesB)  # -> Set, Map
lng = ListLength(List=cset.Set)
gradient = Gradient(
    LowerLimit=0,
    UpperLimit=expr("x-1", lng),
    Parameter=cset.Map,
    stops=[0: RGB(220, 220, 220), 0.5: RGB(0, 128, 128), 1: RGB(47, 66, 244)])
createfolder = CSharpScript(path=concat, create=Toggle(True))  # -> out; inputs path: String, create: Boolean
# ---------- createfolder: C# usings ----------
using System.IO;
using System.Linq;
using System.Data;
using System.Drawing;
using System.Reflection;
using System.Windows.Forms;
using System.Xml;
using System.Xml.Linq;
using System.Runtime.InteropServices;

using Rhino.DocObjects;
using Rhino.Collections;
using GH_IO;
using GH_IO.Serialization;
# ---------- createfolder: C# ----------
    if (create)
    {
      if(!System.IO.Directory.Exists(path))
      {
        System.IO.Directory.CreateDirectory(path);
      }
    }
# ---------- end createfolder ----------
dom = ConstructDomain(DomainStart=expr("-x", number_slider), DomainEnd=number_slider)
rectangle = Rectangle(Plane=PlaneXY(0, 0, 0), XSize=dom, YSize=dom, Radius=0)  # -> Rectangle, Length
solid = SolidFill(ShapeGeometry=sort.ValuesA, Color=gradient)
drawing = ConstructDrawing(ShapesGeometry=solid, Boundary=rectangle.Rectangle, Color=RGBA(255, 255, 255, 0))  # -> Drawing, Boundary
savebmp = SaveBitmap(
    DrawingsShapesGeometry=drawing.Drawing,
    FolderPath=concat,
    FileName=flatten,
    Extension=0,
    Resolution=96,
    Save=Toggle(True))
img2str = SerializeImageToString(ImagePath=savebmp)

# ---- group: RH_OUT:StringImage
txt = Text(img2str)
