# Grasshopper definition building_generation.ghx (Grasshopper 1.0.7)

fsr = GetNumber(AtLeast=1, AtMost=1, Maximum=1.797693135e+308, Minimum=-1.797693135e+308, TreeAccess=False)
hob = GetInteger(AtLeast=1, AtMost=2147483647, Maximum=2147483647, Minimum=-2147483648, TreeAccess=False)
lot = GetGeometry(AtLeast=1, AtMost=2147483647, DeleteInput=False, Filter=1074004029, TreeAccess=True)
seed = GetInteger(AtLeast=1, AtMost=2147483647, Maximum=2147483647, Minimum=-2147483648, TreeAccess=False)
flatten = FlattenTree(Tree=hob, Path="{0}")
flatten_2 = FlattenTree(Tree=lot, Path="{0}")
flatten_3 = FlattenTree(Tree=fsr, Path="{0}")
flatten_4 = FlattenTree(Tree=seed, Path="{0}")
crv = Curve(flatten_2)
int = Integer(flatten_4)
int_2 = Integer(flatten)
num = Number(flatten_3)
area = Area(Geometry=crv)  # -> Area, Centroid
dom = ConstructDomain(DomainStart=Slider(0.1, range=0..0.1), DomainEnd=Slider(0.62, range=0..1))
random = Random(Range=dom, Number=1, Seed=int)
scale = Scale(Geometry=crv, Center=Point(0, 0, 0), Factor=random)  # -> Geometry, Transform
pop2d = Populate2D(Region=scale.Geometry, Count="5", Seed=expr("x-1", 1))  # -> graft(Population)
pop2d_2 = Populate2D(Region=scale.Geometry, Count="5", Seed=1)  # -> graft(Population)
number_slider = Slider(8, range=0..100)
dom_2 = ConstructDomain(DomainStart=expr("-x", number_slider), DomainEnd=number_slider)
rectangle = Rectangle(Plane=pop2d_2, XSize=dom_2, YSize=dom_2, Radius=0)  # -> Rectangle, Length
polygon = Polygon(Plane=pop2d, Radius=Slider(9, range=0..10), Segments=Slider(6, range=0..6), FilletRadius=0)  # -> Polygon, Length
entwine = Entwine(Branch00=rectangle.Rectangle, Branch01=polygon.Polygon, FlattenInputs=True)
join = JoinCurves(Curves=entwine, Preserve=False)  # -> flatten(Curves)
runion = RegionUnion(Curves=join)
area_2 = Area(Geometry=runion)  # -> Area, Centroid
multiplication = Multiplication(A=area_2.Area, B=3)
division = Division(A=multiplication, B=graft(area.Area))
smaller = SmallerThan(FirstNumber=division, SecondNumber=num)  # -> SmallerThan, OrEqualTo
cull = CullPattern(List=runion, CullPattern=smaller.OrEqualTo)
Z = UnitZ(Factor=int_2)
sort = SortList(Keys=cull, ValuesA=cull)  # -> Keys, ValuesA
item = ListItem(List=sort.ValuesA, Index=0, Wrap=True)  # -> Item1, Item
boundary = BoundarySurfaces(Edges=item.Item1)
extr = Extrude(Base=boundary, Direction=Z)

# ---- group: RH_OUT:Geometry
geo = Geometry(extr)
