# Grasshopper definition carbon.ghx (Grasshopper 1.0.7)
# plug-ins: Wombat, EleFront

panel = Panel("Warehouse")  # disabled
panel_2 = Panel("Office")  # disabled
panel_3 = Panel("Landscaping")  # disabled
panel_4 = Panel("Road Cars")  # disabled
panel_5 = Panel("Parking Cars")  # disabled
panel_6 = Panel("Road Trucks")  # disabled
panel_7 = Panel("Parking Trucks")  # disabled
number_slider = Slider(492, range=0..1000)  # disabled
reflay = ReferenceByLayer(LayerName=panel)  # disabled
reflay_2 = ReferenceByLayer(LayerName=panel_2)  # disabled
number_slider_2 = Slider(100, range=0..100)
reflay_3 = ReferenceByLayer(LayerName=panel_3)  # disabled
reflay_4 = ReferenceByLayer(LayerName=panel_4)  # disabled
reflay_5 = ReferenceByLayer(LayerName=panel_5)  # disabled
reflay_6 = ReferenceByLayer(LayerName=panel_6)  # disabled
reflay_7 = ReferenceByLayer(LayerName=panel_7)  # disabled
landscaping_carbon = GetNumber(AtLeast=1, AtMost=1, Maximum=1.797693135e+308, Minimum=-1.797693135e+308, TreeAccess=False)
road_cars_carbon = GetNumber(AtLeast=1, AtMost=1, Maximum=1.797693135e+308, Minimum=-1.797693135e+308, TreeAccess=False)
parking_cars_carbon = GetNumber(AtLeast=1, AtMost=1, Maximum=1.797693135e+308, Minimum=-1.797693135e+308, TreeAccess=False)
road_trucks_carbon = GetNumber(AtLeast=1, AtMost=1, Maximum=1.797693135e+308, Minimum=-1.797693135e+308, TreeAccess=False)
parking_trucks_carbon = GetNumber(AtLeast=1, AtMost=1, Maximum=1.797693135e+308, Minimum=-1.797693135e+308, TreeAccess=False)
landscaping = GetGeometry(AtLeast=1, AtMost=2147483647, DeleteInput=False, Filter=1074004029, TreeAccess=True)
road_cars = GetGeometry(AtLeast=1, AtMost=2147483647, DeleteInput=False, Filter=1074004029, TreeAccess=True)
parking_cars = GetGeometry(AtLeast=1, AtMost=2147483647, DeleteInput=False, Filter=1074004029, TreeAccess=True)
road_trucks = GetGeometry(AtLeast=1, AtMost=2147483647, DeleteInput=False, Filter=1074004029, TreeAccess=True)
parking_trucks = GetGeometry(AtLeast=1, AtMost=2147483647, DeleteInput=False, Filter=1074004029, TreeAccess=True)
wall_office_carbon = GetNumber(AtLeast=1, AtMost=1, Maximum=1.797693135e+308, Minimum=-1.797693135e+308, TreeAccess=False)
roof_carbon = GetNumber(AtLeast=1, AtMost=1, Maximum=1.797693135e+308, Minimum=-1.797693135e+308, TreeAccess=False)
slab_carbon = GetNumber(AtLeast=1, AtMost=1, Maximum=1.797693135e+308, Minimum=-1.797693135e+308, TreeAccess=False)
wall_carbon = GetNumber(AtLeast=1, AtMost=1, Maximum=1.797693135e+308, Minimum=-1.797693135e+308, TreeAccess=False)
shed = GetGeometry(AtLeast=1, AtMost=2147483647, DeleteInput=False, Filter=1074004029, TreeAccess=True)
office = GetGeometry(AtLeast=1, AtMost=2147483647, DeleteInput=False, Filter=1074004029, TreeAccess=True)

landscaping_thickness = Slider(0.1, range=0..1)
road_thickness = Slider(0.2, range=0..1)
parking_thickness = Slider(0.2, range=0..1)
roof_thickness = Slider(0.03, range=0..0.1)
slab_thickness = Slider(0.3, range=0..1)
wall_thickness = Slider(0.6, range=0..1)
column_beam_thickness = Slider(0.1, range=0..1)

aggregate_thickness = Slider(0.3, range=0..1)
aggregate_carbon = Slider(0.0025, range=0..0.01)
fbd = BrepFacesByDirection(Brep=flatten(office), Tolerance=0.9)  # -> Top, Bottom, Sides
lng = ListLength(List=flatten(fbd.Bottom))
sunion = SolidUnion(Breps=flatten(office))
fbd_2 = BrepFacesByDirection(Brep=flatten(shed), Tolerance=0.9)  # -> Top, Bottom, Sides
fbd_3 = BrepFacesByDirection(Brep=sunion, Tolerance=0.9)  # -> Top, Bottom, Sides

# ---- group: Landscaping
geo = Geometry(flatten(landscaping))

# ---- group: Road Cars
geo_2 = Geometry(flatten(road_cars))

# ---- group: Parking Cars
geo_3 = Geometry(flatten(parking_cars))

# ---- group: Road Trucks
geo_4 = Geometry(flatten(road_trucks))

# ---- group: Parking Trucks
geo_5 = Geometry(flatten(parking_trucks))

# ----
srf = Surface(fbd_3.Bottom)
area = Area(Geometry=fbd_2.Bottom)  # -> Area, Centroid
area_2 = Area(Geometry=fbd_3.Top)  # -> Area, Centroid
area_3 = Area(Geometry=fbd_3.Bottom)  # -> Area, Centroid
area_4 = Area(Geometry=geo)  # -> Area, Centroid
area_5 = Area(Geometry=geo_2)  # -> Area, Centroid
area_6 = Area(Geometry=geo_3)  # -> Area, Centroid
area_7 = Area(Geometry=geo_4)  # -> Area, Centroid
area_8 = Area(Geometry=geo_5)  # -> Area, Centroid
dist = Distance(PointA=area_2.Centroid, PointB=area_3.Centroid)
multiplication = Multiplication(A="2350", B=road_thickness, C=area_7.Area, D=flatten(road_trucks_carbon))
multiplication_2 = Multiplication(A="2350", B=parking_thickness, C=area_8.Area, D=flatten(parking_trucks_carbon))
multiplication_3 = Multiplication(A=area_4.Area, B=landscaping_thickness, C=flatten(landscaping_carbon))
multiplication_4 = Multiplication(A="2350", B=road_thickness, C=area_5.Area, D=flatten(road_cars_carbon))
multiplication_5 = Multiplication(A="2350", B=parking_thickness, C=area_6.Area, D=flatten(parking_cars_carbon))
division = Division(A=dist, B=lng)
series = Series(Start=0, Step=division, Count=lng)
multiplication_6 = Multiplication(A=aggregate_thickness, B=flatten(aggregate_carbon), C="1600", D=area_5.Area)
multiplication_7 = Multiplication(A=aggregate_thickness, B=flatten(aggregate_carbon), C="1600", D=area_6.Area)
multiplication_8 = Multiplication(A=aggregate_thickness, B=flatten(aggregate_carbon), C="1600", D=area_7.Area)
multiplication_9 = Multiplication(A=aggregate_thickness, B=flatten(aggregate_carbon), C="1600", D=area_8.Area)
Z = UnitZ(Factor=series)
move = Move(Geometry=srf, Motion=Z)  # -> Geometry, Transform
ma = MassAddition(Input=multiplication_3)  # -> Result, PartialResults
ma_2 = MassAddition(Input=[multiplication_4, multiplication_6])  # -> Result, PartialResults
ma_3 = MassAddition(Input=[multiplication_5, multiplication_7])  # -> Result, PartialResults
ma_4 = MassAddition(Input=[multiplication, multiplication_8])  # -> Result, PartialResults
ma_5 = MassAddition(Input=[multiplication_2, multiplication_9])  # -> Result, PartialResults
area_9 = Area(Geometry=move.Geometry)  # -> Area, Centroid

# ---- group: Roof
geo_6 = Geometry(flatten([fbd_2.Top, fbd_3.Top]))

# ---- group: Walls
geo_7 = Geometry(flatten(fbd_2.Sides))

# ---- group: Slabs
geo_8 = Geometry(flatten([move.Geometry, fbd_2.Bottom]))

# ---- group: Wall Office
geo_9 = Geometry(flatten(fbd_3.Sides))

# ----
area_10 = Area(Geometry=fbd_2.Top)  # -> Area, Centroid
area_11 = Area(Geometry=geo_7)  # -> Area, Centroid
area_12 = Area(Geometry=fbd_2.Bottom)  # -> Area, Centroid
area_13 = Area(Geometry=geo_9)  # -> Area, Centroid
multiplication_10 = Multiplication(A=area_11.Area, B=wall_thickness, C=flatten(wall_carbon))
multiplication_11 = Multiplication(A=area_12.Area, B=slab_thickness, C=flatten(slab_carbon))
multiplication_12 = Multiplication(A=area_13.Area, B=wall_thickness, C=flatten(wall_carbon))
multiplication_13 = Multiplication(A=area_9.Area, B=slab_thickness, C=flatten(slab_carbon))
area_14 = Area(Geometry=geo_9)  # -> Area, Centroid
area_15 = Area(Geometry=geo_6)  # -> Area, Centroid
area_16 = Area(Geometry=geo_8)  # -> Area, Centroid
area_17 = Area(Geometry=geo_7)  # -> Area, Centroid
ma_6 = MassAddition(Input=flatten([area_9.Area, area.Area]))  # -> Result, PartialResults
multiplication_14 = Multiplication(A=area_10.Area, B=roof_thickness, C="7850", D=flatten(roof_carbon))
multiplication_15 = Multiplication(A=area_2.Area, B=roof_thickness, C="7850", D=flatten(roof_carbon))
ma_7 = MassAddition(Input=flatten([multiplication_14, multiplication_11, multiplication_10]))  # -> Result, PartialResults
ma_8 = MassAddition(Input=flatten([multiplication_15, multiplication_13, multiplication_12]))  # -> Result, PartialResults
ma_9 = MassAddition(Input=area_16.Area)  # -> Result, PartialResults
ma_10 = MassAddition(Input=area_17.Area)  # -> Result, PartialResults
ma_11 = MassAddition(Input=area_15.Area)  # -> Result, PartialResults
ma_12 = MassAddition(Input=area_14.Area)  # -> Result, PartialResults
multiplication_16 = Multiplication(A="7850", B=roof_thickness, C=ma_11.Result, D=flatten(roof_carbon))
multiplication_17 = Multiplication(A=ma_9.Result, B=flatten(slab_carbon), C=slab_thickness)
multiplication_18 = Multiplication(A=ma_10.Result, B=flatten(wall_carbon), C=wall_thickness)
multiplication_19 = Multiplication(A=ma_12.Result, B=flatten(wall_office_carbon), C=wall_thickness)
merge = Merge(
    Data1=ma_7.Result,
    Data2=ma_8.Result,
    Data3=ma.Result,
    Data4=ma_2.Result,
    Data5=ma_3.Result,
    Data6=ma_4.Result,
    Data7=ma_5.Result)
entwine = Entwine(
    Branch00=flatten(shed),
    Branch01=flatten(office),
    Branch02=geo,
    Branch03=geo_2,
    Branch04=geo_3,
    Branch05=geo_4,
    Branch06=geo_5,
    FlattenInputs=True)
sort = SortList(Keys=merge)  # -> Keys, ValuesA
item = ListItem(List=sort.Keys, Index=0, Wrap=True)  # -> Item1, Item
ma_13 = MassAddition(Input=flatten([multiplication_16, multiplication_17, multiplication_18, ma.Result, ma_2.Result, ma_3.Result, ma_4.Result, ma_5.Result, multiplication_19]))  # -> Result, PartialResults
gradient = Gradient(
    LowerLimit=item.Item,
    UpperLimit=item.Item1,
    Parameter=merge,
    stops=[0.00868: RGB(0, 128, 0), 0.0999: RGB(255, 255, 0), 1: RGB(255, 0, 0)])
mcol = MeshColours(Mesh=entwine, Colours=graft(gradient))
bang = ExplodeTree(Data=mcol)  # -> Branch0, Branch1, Branch2, Branch3, Branch4, Branch5, Branch6
item_2 = ListItem(List=flatten(gradient), Index=0, Wrap=True)  # -> Item, Item1, Item2, Item3, Item4, Item5, Item6

# ---- group: RH_OUT:GFA
num = Number(ma_6.Result)

# ---- group: RH_OUT:Warehouse
num_2 = Number(ma_7.Result)

# ---- group: RH_OUT:Office
num_3 = Number(ma_8.Result)

# ---- group: RH_OUT:Landscaping
num_4 = Number(ma.Result)

# ---- group: RH_OUT:RoadCars
num_5 = Number(ma_2.Result)

# ---- group: RH_OUT:ParkingCars
num_6 = Number(ma_3.Result)

# ---- group: RH_OUT:RoadTrucks
num_7 = Number(ma_4.Result)

# ---- group: RH_OUT:ParkingTrucks
num_8 = Number(ma_4.Result)

# ---- group: RH_OUT:TotalCarbon
num_9 = Number(ma_13.Result)

# ---- group: RH_OUT:MeshOffice
mesh = Mesh(bang.Branch1)

# ---- group: RH_OUT:MeshLandscaping
mesh_2 = Mesh(bang.Branch2)

# ---- group: RH_OUT:MeshRoadCars
mesh_3 = Mesh(bang.Branch3)

# ---- group: RH_OUT:MeshParkingCars
mesh_4 = Mesh(bang.Branch4)

# ---- group: RH_OUT:MeshRoadTrucks
mesh_5 = Mesh(bang.Branch5)

# ---- group: RH_OUT:MeshParkingTrucks
mesh_6 = Mesh(bang.Branch6)

# ---- group: RH_OUT:MeshWarehouse
mesh_7 = Mesh(bang.Branch0)

# ---- group: RH_OUT:Color1
txt = Text(item_2.Item)

# ---- group: RH_OUT:Color2
txt_2 = Text(item_2.Item1)

# ---- group: RH_OUT:Color3
txt_3 = Text(item_2.Item2)

# ---- group: RH_OUT:Color4
txt_4 = Text(item_2.Item3)

# ---- group: RH_OUT:Color5
txt_5 = Text(item_2.Item4)

# ---- group: RH_OUT:Color6
txt_6 = Text(item_2.Item5)

# ---- group: RH_OUT:Color7
txt_7 = Text(item_2.Item6)
