# Grasshopper definition flood.ghx (Grasshopper 1.0.7)

acid = GetString(AtLeast=1, AtMost=2147483647, TreeAccess=True)
curves = GetGeometry(AtLeast=1, AtMost=2147483647, DeleteInput=False, Filter=1074004029, TreeAccess=True)
flatten = FlattenTree(Tree=acid, Path="{0}")
flatten_2 = FlattenTree(Tree=curves, Path="{0}")
cset = CreateSet(List=flatten)  # -> Set, Map
lng = ListLength(List=cset.Set)  # -> expr("x-1", Length)
gradient = Gradient(
    LowerLimit=0,
    UpperLimit=lng,
    Parameter=cset.Map,
    stops=[0: RGB(234, 38, 0), 0.25: RGB(234, 126, 0), 0.5: RGB(254, 244, 84), 0.75: RGB(173, 203, 249), 1: RGB(75, 107, 169)])
boundary = BoundarySurfaces(Edges=graft(flatten_2))  # -> flatten(Surfaces)

# ---- group: RH_OUT:Values
txt = Text(flatten(flatten))

# ---- group: RH_OUT:Surface
geo = Geometry(boundary)

# ---- group: RH_OUT:Colors
txt_2 = Text(gradient)

# ----
gradient_2 = Gradient(
    LowerLimit=0,
    UpperLimit=1,
    stops=[0: RGB(234, 38, 0), 0.25: RGB(234, 126, 0), 0.5: RGB(254, 244, 84), 0.75: RGB(173, 203, 249), 1: RGB(75, 107, 169)])
gradient_3 = Gradient(
    LowerLimit=0,
    UpperLimit=1,
    stops=[0: RGB(234, 38, 0), 0.25: RGB(234, 126, 0), 0.5: RGB(254, 244, 84), 0.75: RGB(173, 203, 249), 1: RGB(75, 107, 169)])
