# Grasshopper definition fsr.ghx (Grasshopper 1.0.7)

fsr = GetString(AtLeast=1, AtMost=2147483647, TreeAccess=True)
curves = GetGeometry(AtLeast=1, AtMost=2147483647, DeleteInput=False, Filter=1074004029, TreeAccess=True)
flatten = FlattenTree(Tree=fsr, Path="{0}")
flatten_2 = FlattenTree(Tree=curves, Path="{0}")
sort = SortList(Keys=flatten, ValuesA=flatten_2)  # -> Keys, ValuesA
cset = CreateSet(List=sort.Keys)  # -> Set, Map
lng = ListLength(List=cset.Set)  # -> expr("x-1", Length)
gradient = Gradient(
    LowerLimit=0,
    UpperLimit=lng,
    Parameter=cset.Map,
    stops=[0: RGB(234, 38, 0), 0.25: RGB(234, 126, 0), 0.5: RGB(254, 244, 84), 0.75: RGB(173, 203, 249), 1: RGB(75, 107, 169)])
mcol = MeshColours(Mesh=graft(sort.ValuesA), Colours=graft(gradient))

# ---- group: RH_OUT:FSRnum
txt = Text(flatten(sort.Keys))

# ---- group: RH_OUT:Mesh
mesh = Mesh(flatten(mcol))
