# Grasshopper definition hob.ghx (Grasshopper 1.0.7)

hob = GetString(AtLeast=1, AtMost=2147483647, TreeAccess=True)
curves = GetGeometry(AtLeast=1, AtMost=2147483647, DeleteInput=False, Filter=1074004029, TreeAccess=True)
flatten = FlattenTree(Tree=hob, Path="{0}")
flatten_2 = FlattenTree(Tree=curves, Path="{0}")
sort = SortList(Keys=flatten, ValuesA=flatten_2)  # -> Keys, ValuesA
cset = CreateSet(List=sort.Keys)  # -> Set, Map
lng = ListLength(List=cset.Set)  # -> expr("x-1", Length)
gradient = Gradient(
    LowerLimit=0,
    UpperLimit=lng,
    Parameter=cset.Map,
    stops=[0: RGB(253, 245, 230), 0.5: RGB(205, 92, 92), 1: RGB(128, 0, 0)])
boundary = BoundarySurfaces(Edges=graft(sort.ValuesA))  # -> flatten(Surfaces)

# ---- group: RH_OUT:Values
txt = Text(flatten(sort.Keys))

# ---- group: RH_OUT:Surface
geo = Geometry(boundary)

# ---- group: RH_OUT:Colors
txt_2 = Text(gradient)
