# Grasshopper definition image.ghx (Grasshopper 1.0.7)
# plug-ins: Human

basestring = GetString(AtLeast=1, AtMost=2147483647, TreeAccess=True)
curve = GetGeometry(AtLeast=1, AtMost=2147483647, DeleteInput=False, Filter=1074004029, TreeAccess=True)
str2img = DeserializeImageFromString(ImageString=basestring)
img = ImportImage(File=str2img, Rectangle=curve)

# ---- group: RH_OUT:Mesh
mesh = Mesh(img)
