# Grasshopper definition interpolate.ghx (Grasshopper 1.0.7)

curves = GetGeometry(AtLeast=1, AtMost=2147483647, DeleteInput=False, Filter=1074004029, TreeAccess=True)
divdist = DivideDistance(Curve=curves, Distance="100")  # -> Points, Tangents, Parameters
intcrv = Interpolate(Vertices=divdist.Points, Degree=3, Periodic=False, KnotStyle=1)  # -> Curve, Length, Domain
end = EndPoints(Curve=intcrv.Curve)  # -> Start, End
ln = Line(StartPoint=end.Start, EndPoint=end.End)
join = JoinCurves(Curves=[intcrv.Curve, ln], Preserve=False)

# ---- group: RH_OUT:Interpolate
crv = Curve(join)
