# Grasshopper definition mapboxContours.ghx (Grasshopper 1.0.7)
# plug-ins: Heron, HDTTreeUtils

mapbox_api_endpoint = Panel("MVT:https://api.mapbox.com/v4/mapbox.mapbox-terrain-v2/{0}/{1}/{2}.vector.pbf?access_token={3}")
panel = Panel("pk.eyJ1Ijoicml2aW5kdWIiLCJhIjoiY2xmYThkcXNjMHRkdDQzcGU4Mmh2a3Q3MSJ9.dXlhamKyYyGusL3PWqDD9Q")
tilex = GetInteger(AtLeast=1, AtMost=2147483647, Maximum=2147483647, Minimum=-2147483648, TreeAccess=True)
tiley = GetInteger(AtLeast=1, AtMost=2147483647, Maximum=2147483647, Minimum=-2147483648, TreeAccess=True)
zoom = Panel("14")
flatten = FlattenTree(Tree=tilex, Path="{0}")
flatten_2 = FlattenTree(Tree=tiley, Path="{0}")
format = Format(Format=mapbox_api_endpoint, Culture=127, Data0=zoom, Data1=graft(flatten), Data2=flatten_2, Data3=panel)

# ---- group: Heron Import Vector Lite for headless environ
ivl = ImportVectorLite(FilePath=graft(format), PointsOnly=True)  # -> DataExtents, Fields, Values, FeatureGeometry

# ---- group: Create border from MVT extents for removing outside edges of contours
pshift = ShiftPaths(Data=ivl.DataExtents, Offset=-1)
item = ListItem(List=pshift, Index=2, Wrap=True)
cp = ControlPoints(Curve=item)  # -> Points, Weights, Knots
ct = CoordinateTransformation(SourcePoints=cp.Points, SourceSRS="EPSG:3857", DestinationSRS="EPSG:32756")
pline = PolyLine(Vertices=ct, Closed=False)  # -> flatten(Polyline)
runion = RegionUnion(Curves=flatten(pline))
offset = OffsetCurve(Curve=runion, Distance="-1", Corners=1)

# ----
ct_2 = CoordinateTransformation(SourcePoints=ivl.FeatureGeometry, SourceSRS="EPSG:3857", DestinationSRS="EPSG:32756")
item_2 = ListItem(List=ivl.Values, Index="1", Wrap=True)

# ---- group: Convert String to Number
c_script = CSharpScript(x=item_2)  # -> out, A; inputs x: list
# ---------- c_script: C# usings ----------
using System.Threading;
using System.Threading.Tasks;
using System.Linq;
using System.Collections.Concurrent;
# ---------- c_script: C# ----------
    List<GH_Number> doubles = new List<GH_Number>();

    for (int i = 0; i < x.Count; i++)
    {
      try 
      {
        doubles.Add(new GH_Number(Convert.ToDouble(x[i])));
      }
      catch{}
    }

    A = doubles;
# ---------- end c_script ----------

# ----
pline_2 = PolyLine(Vertices=ct_2, Closed=False)
Z = UnitZ(Factor=c_script.A)
pshift_2 = ShiftPaths(Data=pline_2, Offset="-2")
move = Move(Geometry=pshift_2, Motion=Z)  # -> Geometry, Transform
clean = CleanTree(RemoveNulls=True, RemoveInvalid=True, RemoveEmpty=True, Tree=graft(move.Geometry))

# ---- group: Merge tiles to clean up edges
area = Area(Geometry=clean)  # -> Area, Centroid
pdecon = Deconstruct(Point=area.Centroid)  # -> XComponent, YComponent, ZComponent
cset = CreateSet(List=flatten(pdecon.ZComponent))  # -> Set, Map
assign_paths = AssignPaths(InputData=flatten(clean), PathsToAssign=flatten(cset.Map))
runion_2 = RegionUnion(Curves=assign_paths)

# ---- group: Remove tile edges (leaves some gaps)
explode = Explode(Curve=runion_2, Recursive=True)  # -> Segments, Vertices
eval = EvaluateCurve(Curve=reparameterize(explode.Segments), Parameter="0.5")  # -> Point, Tangent, Angle
incurve = PointInCurve(Point=eval.Point, Curve=offset)  # -> Relationship, Point
equals = Equality(FirstNumber=incurve.Relationship, SecondNumber="2")  # -> Equality, Inequality
cull = CullPattern(List=explode.Segments, CullPattern=equals.Equality)
join = JoinCurves(Curves=cull, Preserve=False)

# ---- group: RH_OUT:Contours
crv = Curve(flatten(join))
