# Grasshopper definition procedural.ghx (Grasshopper 1.0.7)

number_slider = Slider(3, range=0..10)
boundary = GetGeometry(AtLeast=1, AtMost=2147483647, DeleteInput=False, Filter=1074004029, TreeAccess=True)
fsr = GetNumber(AtLeast=1, AtMost=2147483647, Maximum=1.797693135e+308, Minimum=-1.797693135e+308, TreeAccess=True)
hob = GetNumber(AtLeast=1, AtMost=2147483647, Maximum=1.797693135e+308, Minimum=-1.797693135e+308, TreeAccess=True)
item = ListItem(List=boundary, Index=0, Wrap=True)
integer_division = IntegerDivision(A=hob, B=number_slider)
area = Area(Geometry=item)  # -> Area, Centroid
addition = Addition(A=integer_division, B=Slider(1, range=0..1))
series = Series(Start=0, Step=number_slider, Count=addition)
scale = Scale(Geometry=item, Center=area.Centroid, Factor=Slider(0.75, range=0..1))  # -> Geometry, Transform
Z = UnitZ(Factor=number_slider)
Z_2 = UnitZ(Factor=series)
move = Move(Geometry=scale.Geometry, Motion=Z_2)  # -> Geometry, Transform
extr = Extrude(Base=move.Geometry, Direction=Z)
cap = CapHoles(Brep=extr)

# ---- group: RH_OUT:Geometry
geo = Geometry(cap)
