# Grasshopper definition roads.ghx (Grasshopper 1.0.7)
# plug-ins: ClipperComponents

curves = GetGeometry(AtLeast=1, AtMost=2147483647, DeleteInput=False, Filter=1074004029, TreeAccess=True)
polyoffset = PolylineOffset(
    Polylines=flatten(curves),
    Distance=Slider(2, range=1..10),
    Plane=Plane(origin=(0, 0, 0), x=(0, 0, 0), y=(0, 0, 0)),
    Tolerance="0.001",
    ClosedFillet=Slider(2, range=0..3),
    OpenFillet=Slider(1, range=0..3),
    Miter=2)  # -> Contour, Holes

# ---- group: RH_OUT:Roads
crv = Curve([polyoffset.Contour, polyoffset.Holes])
