# Grasshopper definition speckle.ghx (Grasshopper 1.0.7)
# plug-ins: Speckle 2

buildings = GetGeometry(AtLeast=1, AtMost=2147483647, DeleteInput=False, Filter=1074004029, TreeAccess=False)
boundary = GetGeometry(AtLeast=1, AtMost=2147483647, DeleteInput=False, Filter=1074004029, TreeAccess=True)
mesh = GetGeometry(AtLeast=1, AtMost=2147483647, DeleteInput=False, Filter=1074004029, TreeAccess=True)
flatten = FlattenTree(Tree=boundary, Path="{0}")
flatten_2 = FlattenTree(Tree=buildings, Path="{0}")
flatten_3 = FlattenTree(Tree=mesh, Path="{0}")
panel = Panel("https://speckle.xyz/streams/f9b611c4ec")
to_speckle = ToSpeckle(Data=flatten_3, preprocessGeometry=False, selectedKitName="Objects")
to_speckle_2 = ToSpeckle(Data=flatten, preprocessGeometry=False, selectedKitName="Objects")
to_speckle_3 = ToSpeckle(Data=flatten_2, preprocessGeometry=False, selectedKitName="Objects")

# ---- group: RH_OUT:Message
txt = Text("Compute/Mesh")

# ----
ss = SynchronousSender(Data=to_speckle, Stream=panel, Message=txt, UseDefaultCache=True, selectedKitName="Objects")
ss_2 = SynchronousSender(Data=to_speckle_3, Stream=panel, Message="Compute/Buildings", UseDefaultCache=True, selectedKitName="Objects")
ss_3 = SynchronousSender(Data=to_speckle_2, Stream=panel, Message="Compute/Boundary", UseDefaultCache=True, selectedKitName="Objects")
