# Grasshopper definition sunlight.ghx (Grasshopper 1.0.7)
# plug-ins: Wombat

panel = Panel("http://climate.onebuilding.org/WMO_Region_5_Southwest_Pacific/AUS_Australia/NSW_New_South_Wales/AUS_NSW_Sydney.Obs-Obsservatory.Hill.947680_TMYx.zip")
downloadepw = LBDownloadWeather(weather_URL=panel)  # -> epw_file, stat_file, ddy_file; plug-in component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
geo = GetGeometry(AtLeast=1, AtMost=2147483647, DeleteInput=False, Filter=1074004029, TreeAccess=True)
context = GetGeometry(AtLeast=1, AtMost=2147483647, DeleteInput=False, Filter=1074004029, TreeAccess=True)
start_m = GetInteger(AtLeast=1, AtMost=1, Maximum=2147483647, Minimum=-2147483648, TreeAccess=False)
start_d = GetInteger(AtLeast=1, AtMost=1, Maximum=2147483647, Minimum=-2147483648, TreeAccess=True)
start_h = GetInteger(AtLeast=1, AtMost=1, Maximum=2147483647, Minimum=-2147483648, TreeAccess=False)
end_m = GetInteger(AtLeast=1, AtMost=1, Maximum=2147483647, Minimum=-2147483648, TreeAccess=False)
end_d = GetInteger(AtLeast=1, AtMost=1, Maximum=2147483647, Minimum=-2147483648, TreeAccess=False)
end_h = GetInteger(AtLeast=1, AtMost=1, Maximum=2147483647, Minimum=-2147483648, TreeAccess=True)
area = Area(Geometry=flatten(context))  # -> Area, Centroid
flatten = FlattenTree(Tree=geo, Path="{0}")
sunion = SolidUnion(Breps=flatten)
flatten_2 = FlattenTree(Tree=sunion, Path="{0}")
fbd = BrepFacesByDirection(Brep=flatten_2, Tolerance=0.9)  # -> Top, Bottom, Sides
area_2 = Area(Geometry=fbd.Bottom)  # -> Area, Centroid
analysisperiod = LBAnalysisPeriod(start_month=start_m, start_day=start_d, start_hour=start_h, end_month=end_m, end_day=end_d, end_hour=end_h)  # -> period, hoys, dates; plug-in component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
importepw = LBImportEPW(epw_file=downloadepw.epw_file)  # -> location, dry_bulb_temperature, dew_point_temperature, relative_humidity, wind_speed, wind_direction, direct_normal_rad, diffuse_horizontal_rad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; plug-in component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
cir = Circle(Plane=area_2.Centroid, Radius=Slider(10, range=0..100))
area_3 = Area(Geometry=flatten_2)  # -> Area, Centroid
incurve = PointInCurve(Point=area.Centroid, Curve=cir)  # -> Relationship, Point
avr = Average(Input=area_3.Centroid)
cir_2 = Circle(Plane=area_2.Centroid, Radius=Slider(100, range=0..100))
cull = CullPattern(List=flatten(context), CullPattern=invert(incurve.Relationship))
sunpath = LBSunPath(location=importepw.location, hoys=analysisperiod.hoys, center_pt=avr, scale=1)  # -> report, vectors, altitudes, azimuths, hoys, sun_pts, analemma, daily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; plug-in component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
lng = ListLength(List=sunpath.vectors)
range = Range(Domain=Domain(0, 1), Steps=lng)
gradient = Gradient(LowerLimit=0, UpperLimit=1, Parameter=range, stops=[0: RGB(0, 0, 0), 1: RGB(255, 255, 255)])
pdecon = Deconstruct(Point=avr)  # -> XComponent, YComponent, ZComponent
number_slider = Slider(1, range=0..1)
area_4 = Area(Geometry=flatten(cull))  # -> Area, Centroid
incurve_2 = PointInCurve(Point=area_4.Centroid, Curve=cir_2)  # -> Relationship, Point
pt = ConstructPoint(XCoordinate=pdecon.XComponent, YCoordinate=pdecon.YComponent, ZCoordinate=0)
cir_3 = Circle(Plane=pt, Radius=Slider(100, range=0..100))
number_slider_2 = Slider(2, range=0..10)
srf = Surface(cir_3)
toggle = BooleanToggle(True)
cull_2 = CullPattern(List=flatten(cull), CullPattern=incurve_2.Relationship)
legendpar = LBLegendParameters(colors=gradient)  # -> leg_par; plug-in component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
gradientlibrary = Ladybug_GradientLibrary(gradIndex="0")  # -> customColors; plug-in component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
directsunhours = LBDirectSunHours(
    vectors=flatten(sunpath.vectors),
    geometry=flatten(srf),
    context=flatten(flatten_2),
    grid_size=number_slider_2,
    offset_dist=number_slider,
    legend_par=legendpar,
    run=toggle)  # -> report, points, results, mesh, legend, title, int_mtx; plug-in component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
dispatch = Dispatch(List=gradientlibrary, DispatchPattern=[True, False])  # -> ListA, ListB
number_slider_3 = Slider(1, range=0..1)
lng_2 = ListLength(List=analysisperiod.hoys)
data = Data(flatten([directsunhours.legend, directsunhours.title]))
legendpar_2 = LBLegendParameters(min="0", max=lng_2, colors=dispatch.ListA, num_decimals="0", seg_height=Slider(3, range=0..10))  # -> leg_par; plug-in component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
item = ListItem(List=data, Index=number_slider_3, Wrap=True)
cull_i = CullIndex(List=data, Indices=number_slider_3, Wrap=True)
bbox = BoundingBox(Content=cull_i, Plane=PlaneXY(0, 0, 0))  # -> Box, Box_2
directsunhours_2 = LBDirectSunHours(
    vectors=flatten(sunpath.vectors),
    geometry=flatten(sunion),
    context=flatten(cull_2),
    grid_size=number_slider_2,
    offset_dist=number_slider,
    legend_par=legendpar_2,
    run=toggle)  # -> report, points, results, mesh, legend, title, int_mtx; plug-in component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
number_slider_4 = Slider(1, range=0..1)
area_5 = Area(Geometry=bbox.Box)  # -> Area, Centroid
lng_3 = ListLength(List=directsunhours_2.points)
text2crv = TextOutlines(TextContent=cull_i, Plane=area_5.Centroid, Face="Arial", Size=Slider(2, range=0..10), Bold=False, Italics=False)  # -> TextCurves, TextBoundingBox
data_2 = Data(flatten([directsunhours_2.legend, directsunhours_2.title]))
ma = MassAddition(Input=directsunhours_2.results)  # -> Result, PartialResults
boundary = BoundarySurfaces(Edges=flatten(text2crv.TextCurves))
item_2 = ListItem(List=data_2, Index=number_slider_4, Wrap=True)
cull_i_2 = CullIndex(List=data_2, Indices=number_slider_4, Wrap=True)
division = Division(A=ma.Result, B=lng_3)
mesh = Mesh(boundary)
bbox_2 = BoundingBox(Content=cull_i_2, Plane=PlaneXY(0, 0, 0))  # -> Box, Box_2
mcol = MeshColours(Mesh=mesh, Colours=ColourSwatch(SwatchColor=RGB(0, 0, 0)))
area_6 = Area(Geometry=bbox_2.Box)  # -> Area, Centroid
text2crv_2 = TextOutlines(TextContent=cull_i_2, Plane=area_6.Centroid, Face="Arial", Size=Slider(1.5, range=0..10), Bold=True, Italics=False)  # -> TextCurves, TextBoundingBox
boundary_2 = BoundarySurfaces(Edges=flatten(text2crv_2.TextCurves))

# ---- group: RH_OUT:shadow_mesh
mesh_2 = Mesh(flatten(directsunhours.mesh))

# ----
item_3 = ListItem(List=item_2, Index=0, Wrap=True)
mesh_3 = Mesh(boundary_2)
area_7 = Area(Geometry=item_3)  # -> Area, Centroid
mcol_2 = MeshColours(Mesh=mesh_3, Colours=ColourSwatch(SwatchColor=RGB(255, 255, 255)))
vec2pt = Vector2Pt(PointA=area_7.Centroid, PointB="0,0,0", Unitize=False)  # -> Vector, Length

# ---- group: RH_OUT:mesh
mesh_4 = Mesh(flatten(directsunhours_2.mesh))

# ---- group: RH_OUT:total_sunlight
num = Number(division)

# ----
move = Move(Geometry=flatten([mcol_2, item_2]), Motion=vec2pt.Vector)  # -> Geometry, Transform

# ---- group: RH_OUT:legend_mesh
mesh_5 = Mesh(move.Geometry)
