# Grasshopper definition sunlight_qld.ghx (Grasshopper 1.0.7)
# plug-ins: Wombat

panel = Panel("http://climate.onebuilding.org/WMO_Region_5_Southwest_Pacific/AUS_Australia/QLD_Queensland/AUS_QLD_Brisbane.945760_TMYx.zip")
downloadepw = LBDownloadWeather(weather_URL=panel)  # -> epw_file, stat_file, ddy_file; plug-in component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
start_m = GetInteger(AtLeast=1, AtMost=1, Maximum=2147483647, Minimum=-2147483648, TreeAccess=False)
start_d = GetInteger(AtLeast=1, AtMost=1, Maximum=2147483647, Minimum=-2147483648, TreeAccess=True)
start_h = GetInteger(AtLeast=1, AtMost=1, Maximum=2147483647, Minimum=-2147483648, TreeAccess=False)
end_m = GetInteger(AtLeast=1, AtMost=1, Maximum=2147483647, Minimum=-2147483648, TreeAccess=False)
end_d = GetInteger(AtLeast=1, AtMost=1, Maximum=2147483647, Minimum=-2147483648, TreeAccess=False)
end_h = GetInteger(AtLeast=1, AtMost=1, Maximum=2147483647, Minimum=-2147483648, TreeAccess=True)
context = GetGeometry(AtLeast=1, AtMost=2147483647, DeleteInput=False, Filter=1074004029, TreeAccess=True)
geo = GetGeometry(AtLeast=1, AtMost=2147483647, DeleteInput=False, Filter=1074004029, TreeAccess=True)
analysisperiod = LBAnalysisPeriod(start_month=start_m, start_day=start_d, start_hour=start_h, end_month=end_m, end_day=end_d, end_hour=end_h)  # -> period, hoys, dates; plug-in component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
importepw = LBImportEPW(epw_file=downloadepw.epw_file)  # -> location, dry_bulb_temperature, dew_point_temperature, relative_humidity, wind_speed, wind_direction, direct_normal_rad, diffuse_horizontal_rad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; plug-in component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
flatten = FlattenTree(Tree=geo, Path="{0}")
area = Area(Geometry=flatten)  # -> Area, Centroid
avr = Average(Input=area.Centroid)
pdecon = Deconstruct(Point=avr)  # -> XComponent, YComponent, ZComponent
sunpath = LBSunPath(location=importepw.location, hoys=analysisperiod.hoys, center_pt=avr, scale=1)  # -> report, vectors, altitudes, azimuths, hoys, sun_pts, analemma, daily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; plug-in component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
lng = ListLength(List=sunpath.vectors)
range = Range(Domain=Domain(0, 1), Steps=lng)
gradient = Gradient(LowerLimit=0, UpperLimit=1, Parameter=range, stops=[0: RGB(0, 0, 0), 1: RGB(255, 255, 255)])
number_slider = Slider(1, range=0..1)
pt = ConstructPoint(XCoordinate=pdecon.XComponent, YCoordinate=pdecon.YComponent, ZCoordinate=0)
cir = Circle(Plane=pt, Radius=Slider(150, range=0..1000))
number_slider_2 = Slider(2, range=0..10)
toggle = BooleanToggle(True)
srf = Surface(cir)
legendpar = LBLegendParameters(colors=gradient)  # -> leg_par; plug-in component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
directsunhours = LBDirectSunHours(
    vectors=flatten(sunpath.vectors),
    geometry=flatten(geo),
    context=flatten(context),
    grid_size=number_slider_2,
    offset_dist=number_slider,
    run=toggle)  # -> report, points, results, mesh, legend, title, int_mtx; plug-in component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
number_slider_3 = Slider(1, range=0..1)
directsunhours_2 = LBDirectSunHours(
    vectors=flatten(sunpath.vectors),
    geometry=flatten(srf),
    context=flatten(geo),
    grid_size=number_slider_2,
    offset_dist=number_slider,
    legend_par=legendpar,
    run=toggle)  # -> report, points, results, mesh, legend, title, int_mtx; plug-in component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
lng_2 = ListLength(List=directsunhours.points)
data = Data(flatten([directsunhours.legend, directsunhours.title]))
number_slider_4 = Slider(1, range=0..1)
ma = MassAddition(Input=directsunhours.results)  # -> Result, PartialResults
item = ListItem(List=data, Index=number_slider_3, Wrap=True)
cull_i = CullIndex(List=data, Indices=number_slider_3, Wrap=True)
division = Division(A=ma.Result, B=lng_2)
data_2 = Data(flatten([directsunhours_2.legend, directsunhours_2.title]))
bbox = BoundingBox(Content=cull_i, Plane=PlaneXY(0, 0, 0))  # -> Box, Box_2
area_2 = Area(Geometry=bbox.Box)  # -> Area, Centroid
item_2 = ListItem(List=data_2, Index=number_slider_4, Wrap=True)
cull_i_2 = CullIndex(List=data_2, Indices=number_slider_4, Wrap=True)
text2crv = TextOutlines(TextContent=cull_i, Plane=area_2.Centroid, Face="Arial", Size=Slider(2, range=0..10), Bold=False, Italics=False)  # -> TextCurves, TextBoundingBox
bbox_2 = BoundingBox(Content=cull_i_2, Plane=PlaneXY(0, 0, 0))  # -> Box, Box_2
boundary = BoundarySurfaces(Edges=flatten(text2crv.TextCurves))
area_3 = Area(Geometry=bbox_2.Box)  # -> Area, Centroid
text2crv_2 = TextOutlines(TextContent=cull_i_2, Plane=area_3.Centroid, Face="Arial", Size=Slider(2, range=0..10), Bold=False, Italics=False)  # -> TextCurves, TextBoundingBox
mesh = Mesh(boundary)
boundary_2 = BoundarySurfaces(Edges=flatten(text2crv_2.TextCurves))
mcol = MeshColours(Mesh=mesh, Colours=ColourSwatch(SwatchColor=RGB(0, 0, 0)))
mesh_2 = Mesh(boundary_2)
mcol_2 = MeshColours(Mesh=mesh_2, Colours=ColourSwatch(SwatchColor=RGB(0, 0, 0)))

# ---- group: RH_OUT:mesh
mesh_3 = Mesh(flatten([directsunhours.mesh, mcol, item]))

# ---- group: RH_OUT:total_sunlight
num = Number(division)

# ---- group: RH_OUT:shadow_mesh
mesh_4 = Mesh(flatten([directsunhours_2.mesh, mcol_2, item_2]))
