# Grasshopper definition test_image.ghx (Grasshopper 1.0.7)

curve = GetGeometry(AtLeast=1, AtMost=1, DeleteInput=False, Filter=1074004029, TreeAccess=True)
filepath = GetFilePath(AtLeast=1, AtMost=1, TreeAccess=True)
img = ImportImage(File=filepath, Rectangle=curve)

# ---- group: RH_OUT:Mesh
mesh = Mesh(img)
