# Grasshopper definition topography.ghx (Grasshopper 1.0.7)

number_slider = Slider(500, range=0..1000)
point = GetPoint(AtLeast=1, AtMost=1, Realtime=True, TreeAccess=False)
curves = GetGeometry(AtLeast=1, AtMost=2147483647, DeleteInput=False, Filter=1074004029, TreeAccess=True)
elevations = GetInteger(AtLeast=1, AtMost=2147483647, Maximum=2147483647, Minimum=-2147483648, TreeAccess=True)
flatten = FlattenTree(Tree=curves, Path="{0}")
flatten_2 = FlattenTree(Tree=elevations, Path="{0}")
dom = ConstructDomain(DomainStart=expr("-x", number_slider), DomainEnd=number_slider)
Z = UnitZ(Factor=flatten_2)
crv = Curve(flatten)
rectangle = Rectangle(Plane=point, XSize=dom, YSize=dom, Radius=0)  # -> Rectangle, Length
move = Move(Geometry=crv, Motion=Z)  # -> Geometry, Transform
divlength = DivideLength(Curve=move.Geometry, Length=Slider(50, range=0..1000))  # -> Points, Tangents, Parameters
incurve = PointInCurve(Point=divlength.Points, Curve=rectangle.Rectangle)  # -> Relationship, Point
cull = CullPattern(List=divlength.Points, CullPattern=incurve.Relationship)
del = DelaunayMesh(Points=flatten(cull), Plane=PlaneXY(0, 0, 0))

# ---- group: RH_OUT:Mesh
mesh = Mesh(del)
