# Grasshopper definition vic_lots.ghx (Grasshopper 1.0.7)

curves = GetGeometry(AtLeast=1, AtMost=2147483647, DeleteInput=False, Filter=1074004029, TreeAccess=True)
flatten = FlattenTree(Tree=curves, Path="{0}")
pcen = PolygonCenter(Polyline=flatten)  # -> CenterV, CenterE, CenterA
cullpt = CullDuplicates(Points=pcen.CenterV, Tolerance=0.1, CullMode=1)  # -> Points, Indices, Valence
item = ListItem(List=flatten, Index=cullpt.Indices, Wrap=True)
index = ItemIndex(List=flatten, Item=item)
item_2 = ListItem(List=flatten, Index=index, Wrap=True)

# ---- group: RH_OUT:Lots
crv = Curve(item_2)
