# Grasshopper definition vic_qld_zoning.ghx (Grasshopper 1.0.7)

zoning = GetString(AtLeast=1, AtMost=2147483647, TreeAccess=True)
curves = GetGeometry(AtLeast=1, AtMost=2147483647, DeleteInput=False, Filter=1074004029, TreeAccess=True)
flatten = FlattenTree(Tree=curves, Path="{0}")
flatten_2 = FlattenTree(Tree=zoning, Path="{0}")
cset = CreateSet(List=flatten_2)  # -> Set, Map
lng = ListLength(List=flatten)
lng_2 = ListLength(List=cset.Set)  # -> expr("x-1", Length)
gradient = Gradient(
    LowerLimit=0,
    UpperLimit=lng_2,
    Parameter=cset.Map,
    stops=[0: RGB(220, 220, 220), 0.5: RGB(0, 128, 128), 1: RGB(47, 66, 244)])
sort = SortList(Keys=flatten, ValuesA=flatten, ValuesC=flatten_2, ValuesB=gradient)  # -> Keys, ValuesA, ValuesC, ValuesB
series = Series(Start=0, Step=Slider(0.0001, range=0..0.0001), Count=lng)
Z = UnitZ(Factor=series)  # -> expr("-x", UnitVector)
move = Move(Geometry=sort.ValuesA, Motion=Z)  # -> Geometry, Transform
mcol = MeshColours(Mesh=graft(move.Geometry), Colours=graft(sort.ValuesB))

# ---- group: RH_OUT:Zone
txt = Text(flatten(sort.ValuesC))

# ---- group: RH_OUT:Mesh
mesh = Mesh(mcol)
