# Grasshopper definition zoning.ghx (Grasshopper 1.0.7)

zoning = GetString(AtLeast=1, AtMost=2147483647, TreeAccess=True)
curves = GetGeometry(AtLeast=1, AtMost=2147483647, DeleteInput=False, Filter=1074004029, TreeAccess=True)
flatten = FlattenTree(Tree=curves, Path="{0}")
flatten_2 = FlattenTree(Tree=zoning, Path="{0}")
data = Data(["CA", "2(a)", "A", "AGB", "B", "B1", "B2", "B2", "B3", "B4"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])
data_2 = Data(["0, 0, 0, 0", "255, 166, 163, 255", "252, 119, 110, 255", "250, 232, 197, 255", "99, 240, 245, 255", "201, 255, 249, 255", "98, 240, 245, 255", "98, 240, 245, 255", "0, 194, 237, 255", "149, 157, 194, 255"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])
lng = ListLength(List=flatten)
keysearch = KeyValueSearch(Keys=flatten(data), Values=flatten(data_2), Search=flatten(flatten_2))
sort = SortList(Keys=flatten, ValuesA=flatten, ValuesC=flatten_2, ValuesB=keysearch)  # -> Keys, ValuesA, ValuesC, ValuesB
series = Series(Start=0, Step=Slider(0.0001, range=0..0.0001), Count=lng)
Z = UnitZ(Factor=series)  # -> expr("-x", UnitVector)
move = Move(Geometry=sort.ValuesA, Motion=Z)  # -> Geometry, Transform
boundary = BoundarySurfaces(Edges=graft(move.Geometry))  # -> flatten(Surfaces)

# ---- group: RH_OUT:Colors
txt = Text(sort.ValuesB)

# ---- group: RH_OUT:Values
txt_2 = Text(flatten(sort.ValuesC))

# ---- group: RH_OUT:Surface
geo = Geometry(boundary)
