# Grasshopper definition zoningColors.ghx (Grasshopper 1.0.7)
# plug-ins: GraphicPlus, Human

panel = Panel("C:\Users\RhinoComputeUser\OneDrive - nettletontribe\Compute\")
filename = GetString(AtLeast=1, AtMost=2147483647, TreeAccess=True)
geometry = GetGeometry(AtLeast=1, AtMost=2147483647, DeleteInput=False, Filter=1074004029, TreeAccess=True)
vals = GetString(AtLeast=1, AtMost=2147483647, TreeAccess=True)
foldername = GetString(AtLeast=1, AtMost=1, TreeAccess=False)
flatten = FlattenTree(Tree=filename, Path="{0}")
flatten_2 = FlattenTree(Tree=geometry, Path="{0}")
flatten_3 = FlattenTree(Tree=vals, Path="{0}")
flatten_4 = FlattenTree(Tree=foldername, Path="{0}")
data = Data(["CA", "2(a)", "A", "AGB", "B", "B1", "B2", "B2", "B3", "B4"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])
data_2 = Data(["0, 0, 0, 0", "255, 166, 163, 255", "252, 119, 110, 255", "250, 232, 197, 255", "99, 240, 245, 255", "201, 255, 249, 255", "98, 240, 245, 255", "98, 240, 245, 255", "0, 194, 237, 255", "149, 157, 194, 255"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])
number_slider = Slider(500, range=0..10000)
mesh = Mesh(flatten_2)
concat = Concatenate(FragmentA=panel, FragmentB=flatten_4)
keysearch = KeyValueSearch(Keys=flatten(data), Values=flatten(data_2), Search=flatten(flatten_3))
sort = SortList(Keys=mesh, ValuesA=mesh, ValuesB=keysearch)  # -> Keys, reverse(ValuesA), reverse(ValuesB)
dom = ConstructDomain(DomainStart=expr("-x", number_slider), DomainEnd=number_slider)
rectangle = Rectangle(Plane=PlaneXY(0, 0, 0), XSize=dom, YSize=dom, Radius=0)  # -> Rectangle, Length
solid = SolidFill(ShapeGeometry=sort.ValuesA, Color=sort.ValuesB)
drawing = ConstructDrawing(ShapesGeometry=solid, Boundary=rectangle.Rectangle, Color=RGBA(255, 255, 255, 0))  # -> Drawing, Boundary
savebmp = SaveBitmap(
    DrawingsShapesGeometry=drawing.Drawing,
    FolderPath=concat,
    FileName=flatten,
    Extension=0,
    Resolution=Slider(200, range=0..1000),
    Save=Toggle(True))
img2str = SerializeImageToString(ImagePath=savebmp)

# ---- group: RH_OUT:StringImage
txt = Text(img2str)
