# Grasshopper definition zoning.ghx (Grasshopper 1.0.7)

curves = GetGeometry(AtLeast=1, AtMost=2147483647, DeleteInput=False, Filter=1074004029, TreeAccess=True)
zoning = GetString(AtLeast=1, AtMost=2147483647, TreeAccess=True)
flatten = FlattenTree(Tree=zoning, Path="{0}")
cset = CreateSet(List=flatten)  # -> Set, Map
lng = ListLength(List=cset.Set)  # -> expr("x-1", Length)
gradient = Gradient(LowerLimit=0, UpperLimit=lng, Parameter=cset.Map, stops=[0: RGB(0, 128, 0), 0.5: RGB(255, 255, 0), 1: RGB(255, 0, 0)])
flatten_2 = FlattenTree(Tree=curves, Path="{0}")
boundary = BoundarySurfaces(Edges=graft(flatten_2))  # -> flatten(Surfaces)
python = GhPythonScript(G=boundary, C=gradient)  # -> a
# ---------- python: Python ----------
import rhinoscriptsyntax as rs
import scriptcontext
import Rhino

ghdoc = scriptcontext.doc

my_doc = Rhino.RhinoDoc.CreateHeadless(None)
my_doc.ModelUnitSystem = Rhino.UnitSystem.Meters
Rhino.RhinoDoc.ActiveDoc = my_doc
doc_object = my_doc.Objects.Find(G)

if doc_object is not None:
    attributes = doc_object.Attributes
    geometry = doc_object.Geometry
    scriptcontext.doc = Rhino.RhinoDoc.ActiveDoc
        
    # We add both the geometry and the attributes to the Rhino doc
    rhino_brep = scriptcontext.doc.Objects.Add(geometry, attributes)
    
    if C:
        attributes.ColorSource = Rhino.DocObjects.ObjectColorSource.ColorFromObject
        attributes.ObjectColor = C

    scriptcontext.doc = ghdoc
    a=rhino_brep
# ---------- end python ----------

# ---- group: RH_OUT:Surface
srf = Surface(python)
